# Grasshopper definition DesignSpace - MeshSubdivision_example.gh (Grasshopper 0.9.76)
# plug-ins: MeshEdit Components, DesignSpace, Weaverbird

mesh = Mesh([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])
number_slider = Slider(11, range=0..11)
wbjoin = WeaverbirdsJoinMeshesAndWeld(Mesh=mesh, Weld=False)
number_slider_2 = Slider(1, range=0..3)
weldvertices = MeshWeldVertices(Mesh=wbjoin, Tolerance=0.01)  # -> RuntimeMessage, Mesh
division = Division(A=number_slider, B="4")
mod = Modulus(A=number_slider, B="4")
tri = Triangulate(Mesh=weldvertices.Mesh)  # -> Mesh, Count
round = Round(Number=division)  # -> Nearest, Floor, Ceiling
wbloop = WeaverbirdsLoopSubdivision(MeshCurves=tri.Mesh, Level=mod, SmoothNakedEdges=0)
wbinnerpolygons = WeaverbirdsInnerPolygonsSubdivision(MeshCurves=wbloop, Level=round.Floor)

# ---- group: DoubleClick Me
ds = DesignSpace(Sliders=number_slider, Geometry=wbinnerpolygons)
