# Grasshopper definition DesignSpace-Lunchbox_example.gh (Grasshopper 0.9.76)
# plug-ins: DesignSpace, LunchBox, Mesh Pipe

number_slider = Slider(12, range=1..12)
sph = Sphere(Base=PlaneXY(0, 0, 0), Radius=1)
hex = HexagonalStructure(Surface=sph, UDivisions=number_slider, VDivisions=number_slider, AdjustShape=0.3, Type=False)  # -> StructureLines, StructureNodes
mpipe = MeshPipe(Curve=hex.StructureLines, Radius=Slider(0.04, range=0..0.1), Accuracy=0.2, Rotation=0, Segments=10, Caps=2)
ds = DesignSpace(Sliders=number_slider, Geometry=mpipe)
